# Grasshopper definition 11_Ro_Wall_Off Axis.gh (Grasshopper 1.0.8)
# plug-ins: Pufferfish, Rhino.Inside for Autodesk Revit, Wombat

doubleclick = BooleanToggle(False)
dss_annotation_panel = Panel("Help on WhiteWork")
# Segment
# group modules into larger coherent parts
# User Interface: I/O
dss_log_v5_2 = PythonScript(Help=doubleclick)  # inputs Help: Boolean
# ---------- dss_log_v5_2: Python ----------
"""
Set grasshopper template and provide easy acces to Help file in intranet

"""

"""
Credits:
    20211117
    Created by Vladimir Ondejcik
    White arkitekter AB

Based on:
    WOMBAT version <0.0.1>
    Script by <Brian Ringley>
        def libraries() by <Giulio Piacentino> see <http://www.grasshopper3d.com/forum/topics/gh-filename-is-python>
        def writeToFile() by <Data Analytics Society> see <https://www.youtube.com/watch?v=-TF3mXhnCDw>
    Script version <15 September 2015> 
    Copyright <Creative Commons Sharealike>
"""


#add dsearch default path located on cad.local
import sys
new_path = r"\\sesthfs02\DSEARCH\REPOSITORY\Grasshopper\Xtras\DsearchCode"
if new_path not in sys.path: sys.path.append(new_path)

#import dsearch plugin
import dsearch as ds

import os

print sys.path

#reload module (this has use when working on module)
#reload(ds.DS_Log)
#reload(ds.DS_Links)

#setup template
template=ds.DS_Links.Template
ds.DS_Log.DS_Template(template)

#run help from module 
if Help:
    helpLink=ds.DS_Links.HelpLink
    ds.DS_Log.DS_Help(helpLink)

    #turn toggle back to false
    obj=ghenv.Component.Params.Input[0].Sources[0]
    obj.Value=False
    obj.ExpireSolution(True)
# ---------- end dss_log_v5_2 ----------

dss_projectnumber = Panel("0000")
dss_projectname = Panel("name")

# ----
# Organization of Grasshopper scripts at White:
# Script should be created and annotated always with notion that other person will need to use/edit them.
# Build your script in modules and segments, use color coding and annotation according this template.
# This standard should be applied to all scripts, big or small.
# 
# Read  guide on white work:
# "https://work.white.se/grasshopper-developer-guide/"
# For Advanced users:
# For design scripts running more than a month use "dsInitialize" and "dsScriptLog" functions on Dsearch tab to log changes over time.
dss_annotation_panel_2 = Panel("""Tip of a day:
You can change default colour grups by right clicking
Graphical templates are located on "Dsearch" tab""")
# GRAPHIC
# STANDARD
# In
# data and geometry import from rhino or external platforms
image = ImageSampler(dss_annotation_panel_2, Filter="Colour", Interpolate=False, Umax=1, Umin=0, Vmax=1, Vmin=0, Wrap=0)

query_grids = QueryGrids()
active_selection = GraphicalElement()
vector = Vector(unitize(active_selection))
line = Line(active_selection)
length = Length(Curve=line)

# ----
# Control
# General
# Monitor
# Out
# variable parameters and script execution
# (sliders, boolean togggle, text input,...)
# monitor data and geometry preview (used for panels for example)
# output data to rhino or external platforms
# WIP
# Annotation
# Plugin
# general annotation and notes
# textbased scripting and special plugins
# f.ex: HumanUI, kangaroo,...
# problematic or under repair or construction
dss_annotation_panel_3 = Panel("general development modules")

# ----
# Rotates curve according to closest near pararell gridline - moves hosted elements a little....
midpoint = Midpoint(Curve=line)
line_2 = Line(query_grids)
vector_2 = Vector(line_2)
dot_product = DotProduct(VectorA=unitize(simplify(graft(vector))), VectorB=unitize(vector_2), Unitize=False)
absolute = Absolute(Value=dot_product)
degrees = Degrees()
radians = Radians(Degrees=Slider(2, range=0..10))
round_to_decimal_place = RoundToDecimalPlace(NumberX=absolute, DecimalPlace="5", RoundType=0)  # -> Rounded, Difference
cosine = Cosine(Value=radians)
round_to_decimal_place_2 = RoundToDecimalPlace(NumberX=cosine, DecimalPlace="5", RoundType=0)  # -> Rounded, Difference
smaller_than = SmallerThan(FirstNumber=round_to_decimal_place.Rounded, SecondNumber=round_to_decimal_place_2.Rounded)  # -> SmallerThan, OrEqualTo
cull_pattern = CullPattern(List=line_2, CullPattern=invert(smaller_than.SmallerThan))
# Back-end
curve_closest_point = CurveClosestPoint(Point=simplify(graft(midpoint)), Curve=cull_pattern)  # -> Point, Parameter, Distance
sort_list = SortList(Keys=curve_closest_point.Distance, ValuesValuesA=cull_pattern)  # -> Keys, simplify(ValuesValuesA)
list_item = ListItem(List=sort_list.ValuesValuesA, Index=0, Wrap=True)  # -> simplify(Item)
vector_3 = Vector(list_item)
vector_4 = Vector(unitize(vector_3))
line_sdl = LineSDL(Start=simplify(graft(midpoint)), Direction=vector_4, Length=simplify(graft(length)))
division = Division(A=length, B=Slider(2, range=0..10))
multiplication = Multiplication(A=vector_4, B=simplify(graft(division)))
negative = Negative(Value=multiplication)
move = Move(Geometry=line_sdl, Motion=negative)  # -> Geometry, Transform
flip_curve = FlipCurve(Curve=move.Geometry, Guide=simplify(graft(line)))  # -> Curve, Flag
list_length = ListLength(List=flatten(flip_curve.Curve))
boolean = Boolean(list_length)
stream_filter = StreamFilter(Gate=boolean, Stream1=flip_curve.Curve)
host_inserts = HostInserts(Host=active_selection)  # -> Inserts, Shared, Shadows, Openings, Walls
element_location = ElementLocation(Element=simplify(host_inserts.Inserts))  # -> Element, Location, Hand, Facing, WorkPlane
data_dam = DataDam(DataDataA=stream_filter, BufferDelay=2500000, BufferMode=2)
line_3 = Line(flip_curve.Curve)
point = Point(element_location.Location)
element_curve = ElementCurve(Element=simplify(graft(active_selection)), Curve=data_dam, FailureProcessingMode=2)  # -> Element, Curve
curve_closest_point_2 = CurveClosestPoint(Point=point, Curve=reparameterize(simplify(graft(line_3))))  # -> simplify(Point), Parameter, Distance
list_length_2 = ListLength(List=flatten(element_curve.Element))
project = Project(Geometry=curve_closest_point_2.Point, Plane=element_location.Location)  # -> Geometry, Transform
boolean_2 = Boolean(list_length_2)
stream_filter_2 = StreamFilter(Gate=boolean_2, Stream1=project.Geometry)
element_location_2 = ElementLocation(Element=simplify(host_inserts.Inserts), Location=stream_filter_2, FailureProcessingMode=2)  # -> Element, Location, Hand, Facing, WorkPlane
